# Grasshopper definition Sergii Protsan_Mobius Pattern.gh (Grasshopper 1.0.7)
# plug-ins: Pufferfish, Weaverbird, Kangaroo2 Components

# ---- group: Mockup Surface (works only for points UV coordinates mapping)
construct_domain = ConstructDomain(DomainStart=Slider(100, range=0..100), DomainEnd=Slider(200, range=0..1000))
pi = Pi(Factor=1)
range = Range(Domain=construct_domain, Steps=Slider(30, range=0..100))
multiplication = Multiplication(A=pi, B=2)
construct_domain_2 = ConstructDomain(DomainStart=0, DomainEnd=multiplication)
bounds = Bounds(Numbers=range)
remap_numbers = RemapNumbers(Value=range, Source=bounds, Target=construct_domain_2)  # -> Mapped, Clipped
sine = Sine(Value=remap_numbers.Mapped)
construct_point = ConstructPoint(XCoordinate=0, YCoordinate=range, ZCoordinate=reverse(sine))
construct_point_2 = ConstructPoint(XCoordinate=range, YCoordinate=0, ZCoordinate=sine)
interpolate = Interpolate(Vertices=construct_point_2, Degree=3, Periodic=False, KnotStyle=1)  # -> Curve, Length, Domain
interpolate_2 = Interpolate(Vertices=construct_point, Degree=3, Periodic=False, KnotStyle=1)  # -> Curve, Length, Domain
extrude_along = ExtrudeAlong(Base=interpolate.Curve, Curve=interpolate_2.Curve)
number_slider = Slider(100, range=0..100)
unit_x = UnitX(Factor=number_slider)
unit_y = UnitY(Factor=number_slider)
move = Move(Geometry=extrude_along, Motion=unit_y)  # -> Geometry, Transform
move_2 = Move(Geometry=extrude_along, Motion=unit_x)  # -> Geometry, Transform

# ---- group: Mobius surface basic section curves
construct_point_3 = ConstructPoint(XCoordinate=0, YCoordinate=0, ZCoordinate=0)
circle_cnr = CircleCNR(Center=construct_point_3, Normal=Vector(0, 0, 1), Radius=Slider(40, range=0..100))
number_slider_2 = Slider(40, range=0..1000)
number_slider_3 = Slider(35, range=0..1000)
curve = Curve(reparameterize(circle_cnr))
number_slider_4 = Slider(1, range=0..10)
negative = Negative(Value=number_slider_2)
negative_2 = Negative(Value=number_slider_3)
perp_frames = PerpFrames(Curve=curve, Count=Slider(75, range=0..100), Align=True)  # -> Frames, Parameters
pi_2 = Pi(Factor=1)
evaluate_curve = EvaluateCurve(Curve=curve, Parameter=perp_frames.Parameters)  # -> Point, Tangent, Angle
construct_domain_3 = ConstructDomain(DomainStart=expr("x/2", negative), DomainEnd=expr("x/2", number_slider_2))
construct_domain_4 = ConstructDomain(DomainStart=expr("x/2", negative_2), DomainEnd=expr("x/2", number_slider_3))
deconstruct_plane = DeconstructPlane(Plane=perp_frames.Frames)  # -> Origin, XAxis, YAxis, ZAxis
multiplication_2 = Multiplication(A=pi_2, B=number_slider_4)
modulus = Modulus(A=number_slider_4, B=2)
construct_domain_5 = ConstructDomain(DomainStart=0, DomainEnd=multiplication_2)
equality = Equality(FirstNumber=modulus, SecondNumber=0)  # -> Equality, Inequality
list_length = ListLength(List=perp_frames.Frames)
rectangle = Rectangle(Plane=perp_frames.Frames, XSize=construct_domain_3, YSize=construct_domain_4, Radius=Slider(5, range=0..10))  # -> Rectangle, Length
range_2 = Range(Domain=construct_domain_5, Steps=list_length)
cull_index = CullIndex(List=range_2, Indices=-1, Wrap=True)
rotate = Rotate(Geometry=rectangle.Rectangle, Angle=cull_index, Plane=perp_frames.Frames)  # -> Geometry, Transform
rotate_3d = Rotate3D(
    Geometry=rotate.Geometry,
    Angle=degrees(Slider(15, range=0..45)),
    Center=evaluate_curve.Point,
    Axis=deconstruct_plane.XAxis)  # -> Geometry, Transform

# ---- group: Pattern waves distance %
number_slider_5 = Slider(25, range=0..100)

# ---- group: V count
number_slider_6 = Slider(20, range=2..100)

# ---- group: Pattern Skew
number_slider_7 = Slider(8, range=2..18)

# ---- group: Pattern Depth
number_slider_8 = Slider(1.5, range=0..10)

# ---- group: pattern seam location
number_slider_9 = Slider(0.125, range=0..1)
number_slider_10 = Slider(50, range=0..75)

# ---- group: Mobius surface rebuilded section curves
curve_2 = Curve(rotate_3d.Geometry)
list_item = ListItem(List=curve_2, Index=0, Wrap=True)
length = Length(Curve=list_item)
integer_division = IntegerDivision(A=length, B=Slider(2.5, range=0..10))
range_3 = Range(Domain=Domain(0, 1), Steps=integer_division)
cull_index_2 = CullIndex(List=range_3, Indices=-1, Wrap=True)
evaluate_curve_2 = EvaluateCurve(Curve=reparameterize(graft(curve_2)), Parameter=cull_index_2)  # -> Point, Tangent, Angle
interpolate_3 = Interpolate(Vertices=evaluate_curve_2.Point, Degree=3, Periodic=True, KnotStyle=1)  # -> reparameterize(flatten(Curve)), Length, Domain
list_length_2 = ListLength(List=interpolate_3.Curve)
range_4 = Range(Domain=Domain(0, 0.5), Steps=list_length_2)
cull_index_3 = CullIndex(List=range_4, Indices=-1, Wrap=True)
seam = Seam(Curve=interpolate_3.Curve, Seam=cull_index_3)
number = Number(number_slider_9)
seam_2 = Seam(Curve=seam, Seam=number)
rebuild_curve = RebuildCurve(Curve=seam_2, Degree=3, Count=25, Tangents=True)
number_2 = Number(number_slider_10)
shift_list = ShiftList(List=rebuild_curve, Shift=number_2, Wrap=True)

# ---- group: U count
number_slider_11 = Slider(20, range=2..100)

# ---- group: Mobius surface
loft = Loft(Curves=shift_list, Options={Adjust=False, Closed=True, LoftEnds=0, LoftSimp=0, LoftType=0, Rebuild=10, Refit=0.01})

# ----
pick_n_choose = PickNChoose(Pattern=Toggle(False), Stream0=loft, Stream1=extrude_along)

# ---- group: Basic surface
surface = Surface(reparameterize(pick_n_choose))

# ----
colour_swatch = ColourSwatch(SwatchColor=RGBA(171, 166, 166, 221))  # disabled
custom_preview = CustomPreview(Geometry=surface, Material=colour_swatch)  # disabled

number_3 = Number(number_slider_6)
number_4 = Number(number_slider_11)

# ---- group: Distorted U coordinates
number_5 = Number(number_4)
division = Division(A=number_5, B=2)
multiplication_3 = Multiplication(A=Slider(8, range=0..10), B=division)
range_5 = Range(Domain=Domain(0, 1), Steps=multiplication_3)
graph_mapper = GraphMapper(range_5, x0=0, x1=1, y0=0, y1=1, container_name="Bipolarity", e=0.25)
number_6 = Number(graph_mapper)

# ---- group: Basic sine wave values
number_7 = Number(number_4)
pi_3 = Pi(Factor=1)
multiplication_4 = Multiplication(A=pi_3, B=number_7)
construct_domain_6 = ConstructDomain(DomainStart=0, DomainEnd=multiplication_4)
remap_numbers_2 = RemapNumbers(Value=range_5, Source=Domain(0, 1), Target=construct_domain_6)  # -> Mapped, Clipped
sine_2 = Sine(Value=remap_numbers_2.Mapped)

# ---- group: V domains for each curve
range_6 = Range(Domain=Domain(0, 1), Steps=number_3)
number_8 = Number(number_slider_5)
list_item_2 = ListItem(List=range_6, Index=1, Wrap=True)
dispatch = Dispatch(List=range_6, DispatchPattern=[True, False])  # -> ListA, ListB
construct_domain_7 = ConstructDomain(DomainStart=0, DomainEnd=list_item_2)
remap_numbers_3 = RemapNumbers(Value=number_8, Source=Domain(0, 100), Target=construct_domain_7)  # -> Mapped, Clipped
cull_index_4 = CullIndex(List=dispatch.ListA, Indices=-1, Wrap=True)
cull_index_5 = CullIndex(List=dispatch.ListA, Indices=0, Wrap=True)
subtraction = Subtraction(A=dispatch.ListB, B=remap_numbers_3.Mapped)
subtraction_2 = Subtraction(A=cull_index_5, B=remap_numbers_3.Mapped)
construct_domain_8 = ConstructDomain(DomainStart=graft(cull_index_4), DomainEnd=graft(subtraction))
construct_domain_9 = ConstructDomain(DomainStart=graft(subtraction_2), DomainEnd=graft(dispatch.ListB))

# ---- group: Attractor curve
bounding_box = BoundingBox(Content=surface, Plane=PlaneXY(0, 0, 0))  # -> Box, Box_2
merge = Merge(Data1="0", Data3="1")  # -> graft(Result)
evaluate_box = EvaluateBox(Box=bounding_box.Box, UParameter=0.5, VParameter=0.5, WParameter=merge)  # -> Plane, Point, Include
polyline = PolyLine(Vertices=flatten(evaluate_box.Plane), Closed=False)

# ---- group: New tree indexes
number_9 = Number(expr("x*2", number_3))
series = Series(Start=0, Step=1, Count=number_9)
partition_list = PartitionList(List=series, Size=4)
list_item_3 = ListItem(List=partition_list, Index=0, Wrap=False)  # -> Item, Item1, Item2, Item3

# ---- group: Sine waves V coordinates
number_10 = Number(sine_2)
domain = Domain(construct_domain_8)
domain_2 = Domain(construct_domain_9)
bounds_2 = Bounds(Numbers=number_10)
remap_numbers_4 = RemapNumbers(Value=number_10, Source=bounds_2, Target=domain)  # -> simplify(Mapped), Clipped
remap_numbers_5 = RemapNumbers(Value=number_10, Source=bounds_2, Target=domain_2)  # -> simplify(Mapped), Clipped
tree_statistics = TreeStatistics(Tree=remap_numbers_4.Mapped)  # -> Paths, Length, Count
tree_statistics_2 = TreeStatistics(Tree=remap_numbers_5.Mapped)  # -> Paths, Length, Count
construct_path = ConstructPath(Indices=list_item_3.Item)  # -> flatten(Branch)
construct_path_2 = ConstructPath(Indices=list_item_3.Item2)  # -> flatten(Branch)
replace_paths = ReplacePaths(Data=remap_numbers_4.Mapped, Search=tree_statistics.Paths, Replace=construct_path)
replace_paths_2 = ReplacePaths(Data=remap_numbers_5.Mapped, Search=tree_statistics_2.Paths, Replace=construct_path_2)
merge_2 = Merge(Data1=replace_paths, Data2=replace_paths_2)

# ----
number_11 = Number(merge_2)

# ---- group: Midlines V coordinates
flip_matrix = FlipMatrix(Data=number_11)
list_item_4 = ListItem(List=flip_matrix, Index=0, Wrap=True)
addition = Addition(A=list_item_4, B="1")
merge_3 = Merge(Data1=flip_matrix, Data2=addition)
relative_differences = RelativeDifferences(Values=merge_3)
cull_index_6 = CullIndex(List=relative_differences, Indices=0, Wrap=True)
division_2 = Division(A=cull_index_6, B="2")
addition_2 = Addition(A=flip_matrix, B=division_2)
dispatch_2 = Dispatch(List=addition_2, DispatchPattern=[True, False])  # -> ListA, ListB
flip_matrix_2 = FlipMatrix(Data=dispatch_2.ListA)
flip_matrix_3 = FlipMatrix(Data=dispatch_2.ListB)
data = Data(flip_matrix_2)
data_2 = Data(list_item_3.Item1)
data_3 = Data(flip_matrix_3)
data_4 = Data(list_item_3.Item3)
tree_statistics_3 = TreeStatistics(Tree=data)  # -> Paths, Length, Count
tree_statistics_4 = TreeStatistics(Tree=data_3)  # -> Paths, Length, Count
construct_path_3 = ConstructPath(Indices=data_2)  # -> flatten(Branch)
construct_path_4 = ConstructPath(Indices=data_4)  # -> flatten(Branch)
replace_paths_3 = ReplacePaths(Data=data, Search=tree_statistics_3.Paths, Replace=construct_path_3)
replace_paths_4 = ReplacePaths(Data=data_3, Search=tree_statistics_4.Paths, Replace=construct_path_4)
merge_4 = Merge(Data1=replace_paths_3, Data2=replace_paths_4)

# ---- group: Basic surface
surface_2 = Surface(reparameterize(surface))

# ---- group: Attractor curve
curve_3 = Curve(polyline)

# ---- group: Distorted U coordinates
number_12 = Number(number_6)

# ---- group: Sine waves V coordinates
number_13 = Number(number_11)

# ---- group: Midlines V coordinates
number_14 = Number(merge_4)

# ---- group: attractor Sine wave curves smoothing
surface_3 = Surface(surface_2)
number_15 = Number(number_12)
number_16 = Number(number_13)
number_17 = Number(number_13)
number_18 = Number(number_13)
number_19 = Number(number_13)
parameter_point_on_surface = ParameterPointOnSurface(Surface=reparameterize(surface_3), ParameterU=number_15, ParameterV=number_16)  # -> Point, Normal
curve_4 = Curve(curve_3)
pull_point = PullPoint(Point=parameter_point_on_surface.Point, Geometry=curve_4, ClosestOnly=True)  # -> ClosestPoint, simplify(Distance)
bounds_3 = Bounds(Numbers=number_19)
bounds_4 = Bounds(Numbers=flatten(pull_point.Distance))
remap_numbers_6 = RemapNumbers(Value=pull_point.Distance, Source=bounds_4, Target=Domain(0, 1))  # -> Mapped, Clipped
tree_statistics_5 = TreeStatistics(Tree=bounds_3)  # -> Paths, Length, Count
graph_mapper_2 = GraphMapper(remap_numbers_6.Clipped, x0=0, x1=1, y0=0, y1=1, Cx=0.2652145624, Cy=0.7150498629, container_name="Conic")
dispatch_3 = Dispatch(List=tree_statistics_5.Paths, DispatchPattern=[True, False])  # -> ListA, ListB
number_20 = Number(graph_mapper_2)
tree_statistics_6 = TreeStatistics(Tree=number_20)  # -> Paths, Length, Count
tree_branch = TreeBranch(Tree=number_17, Path=dispatch_3.ListA, MaintainPaths=True)
tree_branch_2 = TreeBranch(Tree=number_18, Path=dispatch_3.ListB, MaintainPaths=True)
tree_branch_3 = TreeBranch(Tree=bounds_3, Path=dispatch_3.ListA, MaintainPaths=True)
tree_branch_4 = TreeBranch(Tree=bounds_3, Path=dispatch_3.ListB, MaintainPaths=True)
dispatch_4 = Dispatch(List=tree_statistics_6.Paths, DispatchPattern=[True, False])  # -> ListA, ListB
deconstruct_domain = DeconstructDomain(Domain=tree_branch_4)  # -> Start, End
tree_branch_5 = TreeBranch(Tree=number_20, Path=dispatch_4.ListA, MaintainPaths=True)
tree_branch_6 = TreeBranch(Tree=number_20, Path=dispatch_4.ListB, MaintainPaths=True)
remap_numbers_7 = RemapNumbers(Value=tree_branch, Source=tree_branch_3, Target="-1 To 1")  # -> Mapped, Clipped
remap_numbers_8 = RemapNumbers(Value=tree_branch_2, Source=tree_branch_4, Target="1 To -1")  # -> Mapped, Clipped
construct_domain_10 = ConstructDomain(DomainStart=deconstruct_domain.End, DomainEnd=deconstruct_domain.Start)
multiplication_5 = Multiplication(A=tree_branch_5, B=remap_numbers_7.Mapped)
multiplication_6 = Multiplication(A=tree_branch_6, B=remap_numbers_8.Mapped)
domain_3 = Domain(tree_branch_3)
domain_4 = Domain(construct_domain_10)
panel = Panel(remap_numbers_7.Mapped)
remap_numbers_9 = RemapNumbers(Value=multiplication_5, Source="-1 To 1", Target=domain_3)  # -> Mapped, Clipped
remap_numbers_10 = RemapNumbers(Value=multiplication_6, Source="-1 To 1", Target=domain_4)  # -> Mapped, Clipped
merge_5 = Merge(Data1=remap_numbers_9.Mapped, Data2=remap_numbers_10.Mapped, Data3=number_14)

# ---- group: All curves V coordinates
number_21 = Number(merge_5)

# ---- group: Pattern Skew
number_22 = Number(number_21)
number_23 = Number(number_slider_7)
list_length_3 = ListLength(List=number_22)
list_item_5 = ListItem(List=number_22, Index=0, Wrap=True)  # -> flatten(Item)
list_item_6 = ListItem(List=list_length_3, Index=0, Wrap=True)
number_24 = Number(list_item_5)
list_item_7 = ListItem(List=number_24, Index=0, Wrap=True)
addition_3 = Addition(A=list_item_7, B="1")
merge_6 = Merge(Data1=number_24, Data2=addition_3)
relative_differences_2 = RelativeDifferences(Values=merge_6)
cull_index_7 = CullIndex(List=relative_differences_2, Indices=0, Wrap=True)
split_list = SplitList(List=cull_index_7, Index=expr("x*2", number_23))  # -> ListA, ListB
mass_addition = MassAddition(Input=split_list.ListA)  # -> Result, PartialResults
construct_domain_11 = ConstructDomain(DomainStart=0, DomainEnd=mass_addition.Result)  # -> simplify(graft(Domain))
range_7 = Range(Domain=construct_domain_11, Steps=expr("x-1", list_item_6))  # -> simplify(Range)
number_25 = Number(number_22)
addition_4 = Addition(A=number_25, B=range_7)
evaluate = Evaluate(Expression="if(x>1,x-1,x)", x=addition_4)

# ---- group: All curves UV coordinates
parameter_v = Number(number_12)
number_26 = Number(evaluate)

# ----
surface_4 = Surface(surface_2)
number_27 = Number(parameter_v)
number_28 = Number(number_26)
number_29 = Number(number_10)
parameter_point_on_surface_2 = ParameterPointOnSurface(Surface=reparameterize(surface_4), ParameterU=number_27, ParameterV=number_28)  # -> Point, Normal

# ---- group: middle curve concave points
point = Point(parameter_point_on_surface_2.Point)
vector = Vector(parameter_point_on_surface_2.Normal)
number_30 = Number(number_29)
number_31 = Number(number_slider_8)
tree_statistics_7 = TreeStatistics(Tree=point)  # -> Paths, Length, Count
bounds_5 = Bounds(Numbers=number_30)
construct_domain_12 = ConstructDomain(DomainStart=number_31, DomainEnd=0)
construct_domain_13 = ConstructDomain(DomainStart=0, DomainEnd=number_31)
dispatch_5 = Dispatch(List=tree_statistics_7.Paths, DispatchPattern=[True, False])  # -> ListA, ListB
dispatch_6 = Dispatch(List=dispatch_5.ListB, DispatchPattern=[True, False])  # -> ListA, ListB
tree_branch_7 = TreeBranch(Tree=point, Path=dispatch_5.ListA, MaintainPaths=True)  # -> simplify(Branch)
tree_branch_8 = TreeBranch(Tree=point, Path=dispatch_5.ListB, MaintainPaths=True)
remap_numbers_11 = RemapNumbers(Value=number_30, Source=bounds_5, Target=construct_domain_12)  # -> Mapped, Clipped
remap_numbers_12 = RemapNumbers(Value=number_30, Source=bounds_5, Target=construct_domain_13)  # -> Mapped, Clipped
tree_branch_9 = TreeBranch(Tree=vector, Path=dispatch_6.ListB, MaintainPaths=True)
tree_branch_10 = TreeBranch(Tree=vector, Path=dispatch_6.ListA, MaintainPaths=True)
multiplication_7 = Multiplication(A=tree_branch_10, B=remap_numbers_11.Mapped)
multiplication_8 = Multiplication(A=tree_branch_9, B=remap_numbers_12.Mapped)
merge_7 = Merge(Data1=multiplication_7, Data2=multiplication_8)
move_3 = Move(Geometry=tree_branch_8, Motion=merge_7)  # -> simplify(Geometry), Transform

# ---- group: Basic surface
surface_5 = Surface(reparameterize(surface_2))

# ---- group: Midpoints
point_2 = Point(move_3.Geometry)

# ---- group: Wave points
point_3 = Point(tree_branch_7)

# ---- group: Pattern perpendicular section curves
point_4 = Point(point_2)
point_5 = Point(point_3)
tree_statistics_8 = TreeStatistics(Tree=point_5)  # -> Paths, Length, Count
interpolate_4 = Interpolate(Vertices=point_4, Degree=3, Periodic=False, KnotStyle=1)  # -> reparameterize(Curve), Length, Domain
interpolate_5 = Interpolate(Vertices=point_5, Degree=3, Periodic=False, KnotStyle=1)  # -> reparameterize(Curve), Length, Domain
list_item_8 = ListItem(List=tree_statistics_8.Length, Index=0, Wrap=True)
divide_curve = DivideCurve(Curve=interpolate_5.Curve, Count=expr("x-1", list_item_8), Kinks=False)  # -> simplify(Points), Tangents, Parameters
flip_matrix_4 = FlipMatrix(Data=divide_curve.Points)
polyline_2 = PolyLine(Vertices=flip_matrix_4, Closed=True)
explode = Explode(Curve=polyline_2, Recursive=True)  # -> Segments, Vertices
flip_matrix_5 = FlipMatrix(Data=explode.Segments)
curve_middle = CurveMiddle(Curve=flip_matrix_5)  # -> simplify(Midpoint)
end_points = EndPoints(Curve=flip_matrix_5)  # -> Start, End
surface_6 = Surface(surface_5)
surface_closest_point = SurfaceClosestPoint(Point=curve_middle, Surface=surface_6)  # -> Point, UVPoint, Distance
evaluate_surface = EvaluateSurface(Surface=reparameterize(surface_6), Point=surface_closest_point.UVPoint)  # -> Point, Normal, UDirection, VDirection, Frame
curve_5 = Curve(interpolate_4.Curve)
curve_closest_point = CurveClosestPoint(Point=evaluate_surface.Point, Curve=curve_5)  # -> Point, Parameter, Distance
negative_3 = Negative(Value=evaluate_surface.Normal)

# ---- group: attractor pattern depth smooth
pull_point_2 = PullPoint(Point=surface_closest_point.Point, Geometry=curve_3, ClosestOnly=True)  # -> ClosestPoint, Distance
flatten_tree = FlattenTree(Tree=pull_point_2.Distance, Path="{0}")
bounds_6 = Bounds(Numbers=flatten_tree)
deconstruct_domain_2 = DeconstructDomain(Domain=bounds_6)  # -> Start, End
multiplication_9 = Multiplication(A=Slider(2.5, range=1..3), B=deconstruct_domain_2.Start)
construct_domain_14 = ConstructDomain(DomainStart=multiplication_9, DomainEnd=deconstruct_domain_2.End)
remap_numbers_13 = RemapNumbers(Value=pull_point_2.Distance, Source=construct_domain_14, Target=Domain(0, 1))  # -> Mapped, Clipped
graph_mapper_3 = GraphMapper(remap_numbers_13.Clipped, x0=0, x1=1, y0=0, y1=1, Cx=0.3220232725, Cy=0.7191778421, container_name="Conic")
number_32 = Number(graph_mapper_3)

# ---- group: Pattern perpendicular section curves (continued)
multiplication_10 = Multiplication(A=curve_closest_point.Distance, B=negative_3, C=number_32)
move_4 = Move(Geometry=evaluate_surface.Point, Motion=multiplication_10)  # -> simplify(Geometry), Transform
arc_3pt = Arc3Pt(PointA=end_points.Start, PointB=move_4.Geometry, PointC=end_points.End)  # -> simplify(Arc), Plane, Radius
cull_index_8 = CullIndex(List=arc_3pt.Arc, Indices=-1, Wrap=True)
list_item_9 = ListItem(List=cull_index_8, Index=0, Wrap=True)  # -> Item1, flatten(Item)
curve_middle_2 = CurveMiddle(Curve=list_item_9.Item1)
end_points_2 = EndPoints(Curve=list_item_9.Item)  # -> Start, End
closest_point = ClosestPoint(Point=curve_middle_2, Cloud=end_points_2.Start)  # -> ClosestPoint, CPIndex, Distance
list_item_10 = ListItem(List=list_item_9.Item, Index=closest_point.CPIndex, Wrap=True)  # -> simplify(Item)
merge_8 = Merge(Data1=simplify(cull_index_8), Data2=simplify(list_item_10))

# ---- group: Section curves
curve_6 = Curve(merge_8)

# ---- group: Mesh loft and smooth
range_8 = Range(Domain=Domain(0, 1), Steps=Slider(7, range=1..10))
range_9 = Range(Domain=Domain(0, 1), Steps=Slider(1, range=1..10))
parameter_loft_mesh = ParameterLoftMesh(
    Sections=curve_6,
    ParametersU=range_8,
    ParametersV=range_9,
    Weighted=False,
    Lengths=False,
    Angle=0,
    Closed=False,
    Triangulate=False)
combine_clean = CombineClean(Meshes=flatten(parameter_loft_mesh))
weld_mesh = WeldMesh(Mesh=combine_clean, Angle=3.141592654)
weaverbird_s_catmull_clark_subdivision = WeaverbirdsCatmullClarkSubdivision(MeshCurves=weld_mesh, Level=Slider(2, range=1..3), SmoothNakedEdges=1)

# ---- group: Textured mesh
mesh = Mesh(weaverbird_s_catmull_clark_subdivision)

# ----
is_mesh_closed = IsMeshClosed(Mesh=mesh)
bounding_box_2 = BoundingBox(Content=mesh, Plane=PlaneXY(0, 0, 0))  # -> Box, Box_2
panel_2 = Panel(is_mesh_closed)
deconstruct_box = DeconstructBox(Box=bounding_box_2.Box)  # -> Plane, X, Y, Z
deconstruct_domain_3 = DeconstructDomain(Domain=deconstruct_box.Z)  # -> Start, End
negative_4 = Negative(Value=deconstruct_domain_3.Start)
unit_z = UnitZ(Factor=negative_4)
move_5 = Move(Geometry=mesh, Motion=unit_z)  # -> Geometry, Transform
rotate_2 = Rotate(Geometry=move_5.Geometry, Angle=degrees(Slider(315, range=0..360)), Plane=PlaneXY(0, 0, 0))  # -> Geometry, Transform
custom_preview_2 = CustomPreview(Geometry=rotate_2.Geometry, Material=ColourSwatch(SwatchColor=RGB(168, 168, 168)))
